# Grasshopper definition michell_truss.gh (Grasshopper 1.0.7)
# Copyright: © 2017-2018 Pierre Cuvilliers, Caitlin Mueller, Massachusetts Institute of Technology
# plug-ins: Anemone

number = Number(2)
height = Slider(4, range=0..16)
division = Division(A=height, B=number)
alpha = Slider(1.0678, range=0.5..1.5)
scale_y = Slider(1, range=0.5..2)
layer_count = Slider(2, range=-1..10)
scale_x = Slider(1, range=0.5..2)

# ----
# set up remote python
panel = Panel("""numpy
TrussSolver""")
panel_2 = Panel("/Users/noah/miniconda3_try2/envs/STRUCTURAL_OPTIMIZATION_HW2/bin/python")
gh_python_remote = GHPythonRemote(location=panel_2, run=Toggle(True), modules=panel)  # -> out, linked_modules, rpy, import_statements
panel_3 = Panel(gh_python_remote.import_statements)

panel_4 = Panel("/Users/noah/harvard/2021/coursework_fall_2021/4450_COMPUTATIONAL_DESIGN/hw/2/truss_data/")

# ----
# initialize
_0 = Number(0)
number_2 = Number(division)
expression = Expression(alpha=alpha, height=division, Expression="height / Tan(alpha / 2) ")
construct_point = ConstructPoint(XCoordinate=_0, YCoordinate=number_2, ZCoordinate=_0)
construct_point_2 = ConstructPoint(XCoordinate=expression, YCoordinate=_0, ZCoordinate=_0)
line = Line(StartPoint=construct_point, EndPoint=construct_point_2)

desired_length = Slider(40, range=0..40)
galapagos = Galapagos(fitness=expression_6, gene=alpha)
xy_plane = XYPlane(Origin=Point(0, 0, 0))
number_3 = Number(1)

number_4 = Number(0)
alpha_2 = Number(alpha)
fast_loop_start = FastLoopStart(Iterations=layer_count, propagation_edge=line)  # -> port, Counter, Propagation_edge, Radial_edge
explode = Explode(Curve=fast_loop_start.Propagation_edge, Recursive=True)  # -> Segments, Vertices
list_item = ListItem(List=explode.Segments, Index=number_4, Wrap=True)

# ----
# add_edge_type_1
geometry = Geometry(list_item)
alpha_3 = Number(alpha_2)
explode_2 = Explode(Curve=geometry, Recursive=True)  # -> Segments, Vertices
number_5 = Number(1)
perp_frame = PerpFrame(Curve=reparameterize(geometry), Parameter=number_5)
length = Length(Curve=geometry)
list_item_2 = ListItem(List=explode_2.Vertices, Index=0, Wrap=True)
expression_2 = Expression(alpha=alpha_3, height=length, Expression="height / Tan(alpha) ")
deconstruct_plane = DeconstructPlane(Plane=perp_frame)  # -> Origin, XAxis, YAxis, ZAxis
number_6 = Number(1)
negative = Negative(Value=deconstruct_plane.YAxis)
line_sdl = LineSDL(Start=deconstruct_plane.Origin, Direction=negative, Length=expression_2)
explode_3 = Explode(Curve=line_sdl, Recursive=True)  # -> Segments, Vertices
list_item_3 = ListItem(List=explode_3.Vertices, Index=number_6, Wrap=True)
line_2 = Line(StartPoint=list_item_2, EndPoint=list_item_3)
from_origin_line = Geometry(line_2)
radial_line = Geometry(line_sdl)
new_point = Geometry(list_item_3)

number_7 = Number(-1)

# ----
# add_edge_type_2
previous_propagation_edge = Geometry(explode.Segments)
radial_edge = Geometry(radial_line)
number_8 = Number(-1)

list_length = ListLength(List=previous_propagation_edge)
number_9 = Number(1)
subtraction = Subtraction(A=list_length, B=number_9)

# ----
# get_tip
number_10 = Number(-1)

# ----
# add_tip
alpha_4 = Number(alpha_2)
number_11 = Number(1)

# ----
# measure_distance_to_tip
number_12 = Number(0)
construct_point_3 = ConstructPoint(XCoordinate=number_12, YCoordinate=number_12, ZCoordinate=number_12)

fast_loop_start_2 = FastLoopStart(
    Iterations=subtraction,
    propagation_edge=previous_propagation_edge,
    radial_edge=radial_edge,
    old_propagation_edge=previous_propagation_edge)  # -> port, Counter, Propagation_edge, Radial_edge, Old_propagation_edge

number_13 = Number(1)
addition = Addition(A=fast_loop_start_2.Counter, B=number_13)
list_item_4 = ListItem(List=fast_loop_start_2.Old_propagation_edge, Index=addition, Wrap=True)

# ----
# add_center_block
extension_edge = Geometry(list_item_4)
alpha_5 = Number(alpha_2)
radial_edge_2 = Geometry(fast_loop_start_2.Radial_edge)
number_14 = Number(1)
number_15 = Number(1)
perp_frame_2 = PerpFrame(Curve=reparameterize(extension_edge), Parameter=number_14)
perp_frame_3 = PerpFrame(Curve=reparameterize(radial_edge_2), Parameter=number_15)
length_2 = Length(Curve=radial_edge_2)
length_3 = Length(Curve=extension_edge)
deconstruct_plane_2 = DeconstructPlane(Plane=perp_frame_2)  # -> Origin, XAxis, YAxis, ZAxis
expression_3 = Expression(alpha=alpha_5, l_r=length_2, l_e=length_3, Expression="(l_r / Sin(alpha)) + (l_e / Tan(alpha))")
deconstruct_plane_3 = DeconstructPlane(Plane=perp_frame_3)  # -> Origin, XAxis, YAxis, ZAxis
expression_4 = Expression(alpha=alpha_5, l_r=length_2, l_e=length_3, Expression="(l_r / Tan(alpha)) + (l_e / Sin(alpha))")
negative_2 = Negative(Value=deconstruct_plane_2.YAxis)
line_sdl_2 = LineSDL(Start=deconstruct_plane_2.Origin, Direction=negative_2, Length=expression_3)
line_sdl_3 = LineSDL(Start=deconstruct_plane_3.Origin, Direction=deconstruct_plane_3.YAxis, Length=expression_4)
extension = Geometry(line_sdl_3)
radial = Geometry(line_sdl_2)

fast_loop_end = FastLoopEnd(
    port=fast_loop_start_2.port,
    Exit=False,
    Propagation_edge=extension,
    Radial_edge=radial,
    Old_propagation_edge=fast_loop_start_2.Old_propagation_edge,
    RecordData=True,
    TimeOutVal=0)  # -> flatten(propagation_edge), flatten(radial_edge), old_propagation_edge
cull_index = CullIndex(List=fast_loop_end.radial_edge, Indices=number_8, Wrap=True)
cull_index_2 = CullIndex(List=fast_loop_end.propagation_edge, Indices=number_8, Wrap=True)

# ----
# merge_lines
merge = Merge(Data1=flatten(radial_line), Data2=flatten(cull_index))
radial_edge_3 = Geometry(merge)

list_item_5 = ListItem(List=radial_edge_3, Index=number_7, Wrap=True)

final_radial_edge = Geometry(list_item_5)
length_4 = Length(Curve=final_radial_edge)
perp_frame_4 = PerpFrame(Curve=final_radial_edge, Parameter=number_11)
expression_5 = Expression(alpha=alpha_4, height=length_4, Expression="height / Tan(alpha/2) ")
deconstruct_plane_4 = DeconstructPlane(Plane=perp_frame_4)  # -> Origin, XAxis, YAxis, ZAxis
line_sdl_4 = LineSDL(Start=deconstruct_plane_4.Origin, Direction=deconstruct_plane_4.YAxis, Length=expression_5)

merge_2 = Merge(Data1=from_origin_line, Data2=cull_index_2, Data3=line_sdl_4)  # -> flatten(Result)
join_curves = JoinCurves(Curves=merge_2, Preserve=False)  # -> flatten(Curves)

fast_loop_end_2 = FastLoopEnd(
    port=fast_loop_start.port,
    Exit=False,
    Propagation_edge=join_curves,
    Radial_edge=radial_edge_3,
    RecordData=True,
    TimeOutVal=0)  # -> simplify(propagation_edge), radial_edge

geometry_2 = Geometry(fast_loop_end_2.propagation_edge)

list_item_6 = ListItem(List=flatten(geometry_2), Index=number_10, Wrap=True)
explode_4 = Explode(Curve=list_item_6, Recursive=True)  # -> Segments, Vertices
list_item_7 = ListItem(List=explode_4.Vertices, Index=number_10, Wrap=True)

distance = Distance(PointA=construct_point_3, PointB=list_item_7)

expression_6 = Expression(l_c=distance, l_0=desired_length, Expression="(l_c - l_0)  ^ 2")
panel_5 = Panel(expression_6)

curve = Curve(line)
merge_3 = Merge(Data1=curve, Data2=geometry_2)  # -> flatten(Result)
explode_5 = Explode(Curve=merge_3, Recursive=True)  # -> Segments, simplify(Vertices)
ghpython_script = GhPythonScript(
    propagation_lines=explode_5.Vertices,
    file_path=panel_4,
    height=height,
    layer_count=layer_count,
    scale_x=scale_x,
    scale_y=scale_y)  # -> out, a; inputs propagation_lines: tree of Point3d
# ---------- ghpython_script: Python ----------
__author__ = "noah"

import rhinoscriptsyntax as rs

import ghpythonlib.treehelpers as th

import csv
import json

# Turn into list of lists.
propagation_lines = th.tree_to_list(propagation_lines, None)

print("here")
print(propagation_lines)

# Turn into coordinates.
new_propagation_lines = []
for line in propagation_lines:
    new_line = []
    for point in line:
        new_line.append([point.X, point.Y])
    new_propagation_lines.append(new_line)

file_name = file_path + "/"+ str(int(height)) + "_" + str(int(layer_count)) + ".csv"

print(new_propagation_lines)
# Write
with open(file_name, "wb") as f:
    print("here")
    f.write(json.dumps(new_propagation_lines))
    #writer = csv.writer(f)
    #writer.writerows(new_propagation_lines)
# ---------- end ghpython_script ----------

scale_nu = ScaleNU(Geometry=geometry_2, Plane=xy_plane, ScaleX=scale_x, ScaleY=scale_y, ScaleZ=number_3)  # -> Geometry, Transform

# ----
# plotting
xz_plane = XZPlane(Origin=Point(0, 0, 0))
mirror = Mirror(Geometry=fast_loop_end_2.radial_edge, Plane=xz_plane)  # -> Geometry, Transform
mirror_2 = Mirror(Geometry=merge_3, Plane=xz_plane)  # -> Geometry, Transform

# ==== cluster GHPythonRemote: Connects the Grasshopper Python component to an external Python instance.
python = PythonScript()  # -> gh_parent_doc_dir
# ---------- python: Python ----------
from os import path

gh_parent_doc_dir = path.abspath(path.dirname(ghenv.Component.OnPingDocument().Owner.OnPingDocument().FilePath))
# ---------- end python ----------
# GH to python remote example.
# Pierre Cuvilliers, 2017-2018
# Released under the MIT license
# github.com/pilcru/ghpythonremote
# Runs and connects to an external python engine, and
# assigns imported modules to scriptcontext.sticky variables.
# 
# Arguments:
#       code (str): Path to the GH_to_python_sticky.py code file.
#       location (str): Path to a python executable, or to a folder
#             containing `python.exe`, or the name of a conda-created
#             virtual environment prefixed by `conda://` (`conda://env_name`).
#             If empty, finds python from your windows %PATH%.
#       run (boolean): Creates the connection, and imports new
#             modules, when turned to True. Kills the connection,
#             and deletes the references to the imports, when turned
#             to False.
#       modules (str list): List of module names to import in the
#             remote python. They will be added to the
#             scriptcontext.sticky dictionary, allowing them to be
#             reused from other python components in the same
#             Grasshopper document. Submodules (for example
#             `numpy.linalg` have to be added explicitly to this list
#             to be available later.
#       log_level (str from ['NOTSET', 'DEBUG', 'INFO', 'WARNING', 'ERROR', 'CRITICAL']):
#             Logging level to use for the local IronPython and the
#             remote python instance.
#       working_dir (str): Working directory for the remote python
#             instance.
# 
# Returns:
#       out (str): Console output with DEBUG information.
#       linked_modules (str list): list of imported module names.
#       rpy (rpyc connection object): The object representing the
#             remote Python interpreter.
location = ClusterInput()  # location (str): Path to a python executable, or to a folder containing `python.exe`, or the name of a conda-created virtual environment prefixed by `conda://` (`conda://env_name`). If empty, finds python from your windows %PATH%.
run = ClusterInput()  # run (boolean): Creates the connection, and imports new modules, when turned to True. Kills the connection,and deletes the references to the imports, when turned to False.
modules = ClusterInput()  # modules (str list): List of module names to import in the remote python. They will be added to the scriptcontext.sticky dictionary, allowing them to be reused from other python components in the same Grasshopper document. Submodules (for example `numpy.linalg` have to be added explicitly to this list to be available later.
list = ValueList({"CRITICAL", "ERROR", "WARNING", "INFO", "DEBUG", "NOTSET"}, selected="DEBUG")
panel = Panel(python)
ghpythonremote = GHPythonRemote(location=location, run=run, modules=modules, log_level=list, working_dir=panel)  # -> out, linked_modules, rpy; inputs run: Boolean, modules: list
# ---------- ghpythonremote: Python ----------
import inspect
import logging
from os import path
import sys
from time import sleep

import scriptcontext

import ghpythonremote
from ghpythonremote.connectors import GrasshopperToPythonRemote

local_log_level = getattr(logging, log_level, logging.WARNING)
logger = logging.getLogger("ghpythonremote")
logger.setLevel(local_log_level)
ch = logging.StreamHandler()
ch.setLevel(local_log_level)
formatter = logging.Formatter("%(levelname)s: %(name)s:\n%(message)s")
ch.setFormatter(formatter)
logger.handlers = []
logger.addHandler(ch)
logger = logging.getLogger("ghpythonremote.GH_to_python")

ROOT = path.abspath(path.dirname(inspect.getfile(ghpythonremote)))
rpyc_server_py = path.join(ROOT, "pythonservice.py")

# Set connection to CLOSED if this is the first run
# and initialize set of linked modules
try:
    remote_python_status
except NameError:
    remote_python_status = "CLOSED"
    lkd_modules = set()

# Wait for connection to connect or terminate
timer = 0
while remote_python_status == "CONNECTING" or remote_python_status == "CLOSING":
    sleep(1)
    timer += 1
    if timer == 10:
        try:
            gh2py_manager.__exit__(*sys.exc_info())
        except Exception:
            pass
        remote_python_status = "CLOSED"
        lkd_modules = set()
        raise RuntimeError(
            "Connection left in an inconsistent state and not returning. Reset "
            "everything."
        )

if run:
    if not remote_python_status == "OPEN":
        remote_python_status = "CONNECTING"
        gh2py_manager = GrasshopperToPythonRemote(
            rpyc_server_py,
            location=location,
            timeout=10,
            port=None,
            log_level=log_level,
            working_dir=working_dir,
        )
        gh2py = gh2py_manager.__enter__()
        remote_python_status = "OPEN"

    # Stuff that we can reach
    rpymod = gh2py.py_remote_modules  # A getter function for a named python module
    rpy = gh2py.connection  # Represents the remote instance root object
    scriptcontext.sticky["rpy"] = rpy
    # Add modules
    for mod in modules:
        try:
            scriptcontext.sticky[mod] = rpymod(mod)
            lkd_modules.add(mod)
        except ImportError:
            gh2py_manager.__exit__(*sys.exc_info())
            raise

elif not remote_python_status == "CLOSED":
    remote_python_status = "CLOSING"
    # Remove linked modules
    for mod in lkd_modules:
        del scriptcontext.sticky[mod]
    del scriptcontext.sticky["rpy"]
    gh2py_manager.__exit__(*sys.exc_info())
    lkd_modules = set()
    remote_python_status = "CLOSED"

# Change variable name because ghpython resets outputs to None before each run
linked_modules = lkd_modules

logger.info("GH to python connection is {}".format(remote_python_status))
# ---------- end ghpythonremote ----------
out = ClusterOutput(ghpythonremote.out)  # Console output.
linked_modules = ClusterOutput(ghpythonremote.linked_modules)  # Names of modules that were successfully added to the scriptcontext.sticky dictionary.
rpy = ClusterOutput(ghpythonremote.rpy)  # The object representing the remote python instance
python_2 = PythonScript(module_names=ghpythonremote.linked_modules)  # -> import_statements; inputs module_names: list
# ---------- python_2: Python ----------
import_statements = ["import scriptcontext as sc"]
for module_name in module_names:
    import_statements.append("{0} = sc.sticky['{0}']".format(module_name))

if len(module_names) == 0:
    import_statements = []
# ---------- end python_2 ----------
import_statements = ClusterOutput(python_2)  # Useful import statements to use the imported modules in your scripts.
