# Grasshopper definition CurvedFrameExample.gh (Grasshopper 1.0.7)
# plug-ins: MOO, Radical, karambaGH, Sift, Sampler, Capture, goat

weight_num_elements = Slider(0, range=0..10)
weight_structual_weight = Slider(1, range=0..10)
weight_unshaded_area = Slider(0, range=0..10)
number_slider = Slider(20, range=2..20)
x_2_canopy_tip_x = Slider(20, range=10..20)
x_4_support_cable_count = Slider(2, range=2..20)
x_3_canopy_tip_z = Slider(6, range=6..14)
x_1_lower_support_height = Slider(14, range=6..14)
int = Integer(number_slider)

# ----
# optimizer
goat = Goat(fitness=num_9, gene=[number_slider, x_3_canopy_tip_z, x_2_canopy_tip_x, x_1_lower_support_height])

panel = Panel(int)

# ----
# canopy_geometry
_0 = Number(0)
_15 = Number(15)
upper_support = ConstructPoint(XCoordinate=_0, YCoordinate=_0, ZCoordinate=_15)
tip_point = ConstructPoint(XCoordinate=x_2_canopy_tip_x, YCoordinate=_0, ZCoordinate=x_3_canopy_tip_z)
lower_support = ConstructPoint(XCoordinate=_0, YCoordinate=_0, ZCoordinate=x_1_lower_support_height)
ln = Line(StartPoint=lower_support, EndPoint=tip_point)
divide = DivideCurve(Curve=ln, Count=panel, Kinks=False)  # -> Points, Tangents, Parameters
a = CullIndex(List=divide.Points, Indices=-1, Wrap=True)
b = CullIndex(List=divide.Points, Indices=0, Wrap=True)
item = ListItem(List=divide.Points, Index=0, Wrap=True)
cull_i = CullIndex(List=divide.Points, Indices=0, Wrap=True)
ln_2 = Line(StartPoint=a, EndPoint=b)
merge = Merge(Data1=item, Data2=upper_support)  # -> flatten(Result)
ln_3 = Line(StartPoint=upper_support, EndPoint=cull_i)

colour = ColourPicker(PickedColour=RGB(0, 0, 0))
num = Number(-2)
X = UnitX(Factor=num)
move = Move(Geometry=lower_support, Motion=X)  # -> Geometry, Transform
tag = TextTag(Location=move.Geometry, Text=x_1_lower_support_height, Colour=colour)
num_2 = Number(2)
expression = Expression(x=x_2_canopy_tip_x, y=x_3_canopy_tip_z, Expression="Format(\"{0}, {1}\", x, y)")
X_2 = UnitX(Factor=num_2)
move_2 = Move(Geometry=tip_point, Motion=X_2)  # -> Geometry, Transform
tag_2 = TextTag(Location=move_2.Geometry, Text=expression, Colour=colour)

# ----
# unshaded_area
expression_2 = Expression(canopy_tip_x=x_2_canopy_tip_x, canopy_tip_z=x_3_canopy_tip_z, Expression="(20-canopy_tip_x) + canopy_tip_z/Sqrt(3)")
num_3 = Number(20)
division = Division(A=expression_2, B=num_3)
num_4 = Number(division)

panel_2 = Panel(num_4)

# ----
# number_of_elements
num_5 = Number(panel)
expression_3 = Expression(s=num_5, Expression="s + 1")
num_6 = Number(21)
division_2 = Division(A=expression_3, B=num_6)
num_7 = Number(division_2)

panel_3 = Panel(num_7)

# ----
# load
len = Length(Curve=ln)
support_point_count = Number(panel)
canopy_length = Number(len)
expression_4 = Expression(l=canopy_length, c=support_point_count, Expression="-1 * l/c")
unit_z = UnitZ(Factor=expression_4)
loads = LoadsKaramba3D(Vector=unit_z, LCase=0, mode="Gravity")

panel_4 = Panel("G:\My Drive\2021\coursework_fall_2021\4450_COMPUTATIONAL_DESIGN\hw\4\data\screenshots")
panel_5 = Panel(division)

# ----
# Enumeration with Sampler and Capture
panel_6 = Panel("G:\My Drive\2021\coursework_fall_2021\4450_COMPUTATIONAL_DESIGN\hw\4\data")
sampler = Sampler(
    Variables=[x_1_lower_support_height, x_2_canopy_tip_x, x_3_canopy_tip_z, panel],
    Samples=Slider(44, range=1..200),
    Type=0,
    Seed="0",
    Filename="sample",
    Directory=panel_6)  # -> DesignMap, Data

sift = Sift(
    Variables=[x_1_lower_support_height, x_2_canopy_tip_x, x_3_canopy_tip_z, panel],
    DesignMap=sampler.DesignMap,
    Index=Slider(7, range=0..49))
panel_7 = Panel(sampler.DesignMap)

# ----
# composite_function
num_elements = Number(num_7)
unshaded_area = Number(num_4)

# ----
# structure
canopy_segments = Geometry(ln_2)
free_point = Point(cull_i)
fix_point = Point(merge)
support_segments = Geometry(ln_3)
points_all = Merge(Data1=fix_point, Data2=free_point)  # -> flatten(Result)

# ----
# support
free_point_2 = Point(free_point)
fix_point_2 = Point(fix_point)
support_karamba3d = SupportKaramba(PosInd=fix_point_2, menu=[buttons(on, on, on, on, off, on)])
support_karamba3d_2 = SupportKaramba(PosInd=free_point_2, menu=[buttons(off, on, off, off, off, off)])

# ----
# elements
line_to_beam_karamba3d = LineToBeamKaramba3D(Line=canopy_segments, New=True, Remove=True, LimitDistance_m=0.005, Bending=False)  # -> Element, Points, Info
linetobeam = LineToBeamKaramba3D(Line=support_segments, New=True, Remove=True, LimitDistance_m=0.005, Bending=False)  # -> Element, Points, Info

merge_2 = Merge(Data1=line_to_beam_karamba3d.Element, Data2=linetobeam.Element)  # -> flatten(Result)
merge_3 = Merge(Data1=support_karamba3d_2, Data2=support_karamba3d)  # -> flatten(Result)

# ----
# Structural Assembly and Analysis
assemble_model_karamba3d = AssembleModelKaramba(Point=points_all, Elem=merge_2, Support=merge_3, Load=loads, LimitDistance_m=0.005)  # -> Model, Info, Mass_kg, CenterOfGravity
analyze_karamba3d = AnalyzeKaramba3D(Model=assemble_model_karamba3d.Model)  # -> CalculatedModel, MaximumDisplacement_cm, ResultingForceOfGravity_kN, ElasticEnergy_kNm

# ----
# objectives
# structural_weight
merge_4 = Merge(Data1=canopy_segments, Data2=support_segments)  # -> flatten(Result)
beam_forces_karamba3d = BeamForcesKaramba(
    AnalyzedModel=analyze_karamba3d.CalculatedModel,
    LCase=-1,
    MaximumDistanceFtBetweenResults=-1,
    NumberOfResultsPerBeamElement=2)  # -> AnalyzedModel, NormalForce_kN, ShearForceVz_kN, ShearForceVy_kN, BendingMomentMt_kNm, BendingMomentMy_kNm, BendingMomentMz_kNm
average = Average(Input=beam_forces_karamba3d.NormalForce_kN)  # -> flatten(ArithmeticMean)
length = Length(Curve=merge_4)
absolute = Absolute(Value=average)
multiplication = Multiplication(A=length, B=absolute)
ma = MassAddition(Input=multiplication)  # -> Result, PartialResults
division_3 = Division(A=ma.Result, B="519.38")
num_8 = Number(division_3)

panel_8 = Panel(ma.Result)
panel_9 = Panel(num_8)

structural_weight = Number(num_8)
expression_5 = Expression(
    sw=structural_weight,
    sw_w=weight_structual_weight,
    ua=unshaded_area,
    ua_w=weight_unshaded_area,
    ne=num_elements,
    ne_w=weight_num_elements,
    Expression="sw*sw_w + ua*ua_w + ne*ne_w")
num_9 = Number(expression_5)

panel_10 = Panel(expression_5)

objectives = Data([num_8, num_4, num_7])
capture = Capture(
    Variables=[x_1_lower_support_height, x_2_canopy_tip_x, x_3_canopy_tip_z, panel],
    Objectives=objectives,
    Mode=0,
    Properties=0,
    DesignMap=sampler.DesignMap,
    CsvFilename="moo-data",
    CsvDirectory=panel_6,
    ScreenshotFilename="moo",
    ScreenshotDirectory=panel_4,
    BackupFrequency=0)  # -> DesignMapObjectives, CapturedProperties, Data, Images, I

radical = Radical()  # -> ObjectiveEvolution, VariableEvolution, GradientEvolution
moo = MOO(
    Variables=[x_1_lower_support_height, x_2_canopy_tip_x, x_3_canopy_tip_z, x_4_support_cable_count],
    Objectives=objectives,
    PopulationSize=20,
    Generations=10,
    Seed="0",
    Filename="moo-pareto",
    Directory=panel_6)  # -> ParetoFront, AllSolutions

panel_11 = Panel(objectives)
panel_12 = Panel(capture.DesignMapObjectives)

# ----
# Results Visualization
model_view_karamba3d = ModelViewKaramba(Model=analyze_karamba3d.CalculatedModel, LoadCaseFactorsForLinearSuperposition=1, IndexIncrementOfVisibleLoadcase=0)  # -> Model, MeshOfRendering, DeformedStructure, DeformedModel
beam_view_karamba3d = BeamViewKaramba(Model=model_view_karamba3d.Model)  # -> Model, MeshesOfRenderedBeams, DeformedBeamAxes, LegendColors, LegendTags
