# Grasshopper definition FDM.ghx (Grasshopper 1.0.7)
# plug-ins: Hops, Heteroptera

# ---- group: fixed nodes
point = Point([<point referenced from the Rhino model> x4])

# ---- group: all edge elements
curve = Curve([<curve referenced from the Rhino model> x60])

# ----
side_length = Slider(9.94, range=0..10)
shear = Slider(0, range=0..10)
q = Slider(1, range=0.001..1)
grid_count = Slider(6, range=0..10)

# ---- group: Choose one load (applied to all points) or a list of loads (one per point)
gene_pool = GenePool(Decimals=2, Maximum=1, Minimum=0, Value=[0.5, 1, 0.5, 0.5, 0.13, 0.5, 0.5, 0.5, 0.5, 0.5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])
unit_z = UnitZ(Factor="+1")
unit_z_2 = UnitZ(Factor=gene_pool)
loads = Data(unit_z)
vector = Vector(loads)

# ----
gene_pool_2 = GenePool(Decimals=2, Maximum=1, Minimum=0, Value=[0.5, 0.29, 0.77, 0.1, 0.5, 0.04, 0.8, 0.2, 0.57, 0.15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])

# ---- group: get unduplicated nodes
# Force Density Method
# 
# 4.450 Fall 2019,  Yijiang Huang & Pierre Cuvilliers
# Finds the equilibrium shape of a network of bars using the force density method.
# 
# Arguments:
#       export (bool) : if True save the initial data (required to run FDM) to a json file
#       save_data_folder (string): folder to save the json file
#       compute_fdm (bool): if True, trigger the compute_fdm function directly
#       nodes (list of points):  All nodes (fixed and free) that the FDM acts on.
#       edges (list of curves): Lines connecting nodes together, and defining the
#             connectivity of the network. All end points of edges should be in nodes.
#             The connectivity is defined between endpoints of the line, points simply
#             along the line are not connected.
#       fixed_nodes (list of points): a list of fixed points, should be a subset of nodes
#       force_densities (scalar or list of scalar): The force densities. Can be one scalar
#             value that will be assigned to all edges, or a list of values, one for each edge.
#       loads (vector or list of vectors): The loads applied to the nodes of the network.
#             Can be one vector applied to all nodes, or a list of vectors, one for each node.
# 
# Returns:
#       optimized_nodes: The nodes in their equilibrium positions
#       optimized_lines: The edges in their equilibrium positions
curve_curve = CurveCurve(CurveA=curve, CurveB=curve)  # -> Points, ParamsA, ParamsB
create_set = CreateSet(List=flatten(curve_curve.Points))  # -> Set, Map

# ----
construct_point = ConstructPoint(XCoordinate="0.", YCoordinate="0.", ZCoordinate="0.")
multiplication = Multiplication(A=side_length, B=grid_count)
unit_x = UnitX(Factor=shear)
unit_y = UnitY(Factor=side_length)
addition = Addition(A="0.", B=side_length)
construct_point_2 = ConstructPoint(XCoordinate=addition, YCoordinate="0.", ZCoordinate="0.")
line = Line(StartPoint=construct_point, EndPoint=construct_point_2)
move = Move(Geometry=line, Motion=unit_y)  # -> Geometry, Transform
move_2 = Move(Geometry=move.Geometry, Motion=unit_x)  # -> Geometry, Transform
divide_curve = DivideCurve(Curve=line, Count=grid_count, Kinks=False)  # -> Points, Tangents, Parameters
divide_curve_2 = DivideCurve(Curve=move_2.Geometry, Count=grid_count, Kinks=False)  # -> Points, Tangents, Parameters
line_2 = Line(StartPoint=divide_curve.Points, EndPoint=divide_curve_2.Points)
list_item = ListItem(List=line_2, Index=0, Wrap=True)  # -> Item1, Item
divide_curve_3 = DivideCurve(Curve=list_item.Item, Count=grid_count, Kinks=False)  # -> Points, Tangents, Parameters
divide_curve_4 = DivideCurve(Curve=list_item.Item1, Count=grid_count, Kinks=False)  # -> Points, Tangents, Parameters
line_3 = Line(StartPoint=divide_curve_4.Points, EndPoint=divide_curve_3.Points)
merge = Merge(Data1=flatten(line_3), Data2=flatten(line_2))

force_densities = Data(q)
square = Square(Value=grid_count)
multiplication_2 = Multiplication(A=loads, B=25)
division = Division(A=multiplication_2, B=square)
number = Number(force_densities)
network_from_lines = NetworkFromLines(Lines=merge)  # -> PointPointTopology, simplify(ConnectionPointTopology), simplify(flatten(Points)), flatten(Lines)

# ----
# edge indices
edge_curves = Geometry(curve)
nodes = Geometry(create_set.Set)
end_points = EndPoints(Curve=edge_curves)  # -> Start, End
closest_point = ClosestPoint(Point=end_points.Start, Cloud=nodes)  # -> ClosestPoint, CPIndex, Distance
closest_point_2 = ClosestPoint(Point=end_points.End, Cloud=nodes)  # -> ClosestPoint, CPIndex, Distance
merge_2 = Merge(Data1=graft(closest_point.CPIndex), Data2=graft(closest_point_2.CPIndex))  # -> simplify(Result)

divide_curve_5 = DivideCurve(Curve=merge, Count=grid_count, Kinks=False)  # -> Points, Tangents, Parameters
nodes_2 = Geometry(network_from_lines.Points)
geometry = Geometry(network_from_lines.Points)
explode = Explode(Curve=merge, Recursive=True)  # -> Segments, Vertices
curve_curve_2 = CurveCurve(CurveA=merge, CurveB=explode.Segments)  # -> Points, ParamsA, ParamsB
curve_curve_3 = CurveCurve(CurveA=merge, CurveB=merge)  # -> Points, ParamsA, ParamsB

# ----
# fixed indices
closest_point_3 = ClosestPoint(Point=point, Cloud=nodes_2)  # -> ClosestPoint, CPIndex, Distance

all_points = Geometry(curve_curve_2.Points)
boundary = Geometry(curve_curve_3.Points)
panel = Panel(boundary)
edge_list = Data(network_from_lines.ConnectionPointTopology)
trigger_computation = BooleanToggle(True)
hops = Hops(
    Bool=trigger_computation,
    Nodes=nodes_2,
    Edges=edge_list,
    Loads=division,
    ForceDensities=number,
    FixedNodeID=closest_point_3.CPIndex,
    CacheResultsInMemory=False,
    CacheSolveResults=False,
    RemoteDefinitionLocation="http://127.0.0.1:5000/fdm",
    RemoteSolveVersion=(0, 1, 0),
    ShowInput_Enabled=False,
    ShowInput_Path=False,
    SynchronousSolve=True)

# ---- group: visualize load vectors
colour_cmyk = ColourCMYK(Cyan=1, Magenta=0, Yellow=0, Key=0)
point_2 = Point(hops)
vector_display_ex = VectorDisplayEx(Point=point_2, Vector=division, Colour=colour_cmyk, Width=2)

# ---- group: visualize load vectors on the initial grid
vector_display_ex_2 = VectorDisplayEx(Point=flatten(nodes_2), Vector=division, Colour=colour_cmyk, Width=2)

# ----
# new edges
edge_indices = Data(edge_list)
list_item_2 = ListItem(List=hops, Index=edge_indices, Wrap=True)
list_item_3 = ListItem(List=list_item_2, Index=0, Wrap=True)  # -> flatten(Item), flatten(Item1)
line_4 = Line(StartPoint=list_item_3.Item, EndPoint=list_item_3.Item1)

# ---- group: visualize force density
cluster = Cluster(curve=line_4, number=number)  # -> point, result
text_tag_3d = TextTag3D(Location=cluster.point, Text=cluster.result, Size=Slider(0.1, range=0..1), Justification=7)

# ----
length = Length(Curve=line_4)
# Sum of F * d
multiplication_3 = Multiplication(A=length, B=number)
mass_addition = MassAddition(Input=multiplication_3)  # -> Result, PartialResults
panel_2 = Panel(mass_addition.Result)

# ==== cluster Cluster
curve = ClusterInput()
number = ClusterInput()
curve_2 = Curve(reparameterize(curve))
number_2 = Number(number)
concatenate = Concatenate(FragmentA="q:", FragmentB=number_2)
evaluate_curve = EvaluateCurve(Curve=curve_2, Parameter="0.5")  # -> Point, Tangent, Angle
result = ClusterOutput(concatenate)
point = ClusterOutput(evaluate_curve.Point)
