# Grasshopper definition FDM.ghx (Grasshopper 1.0.7)
# plug-ins: Hops

# ---- group: fixed nodes
point = Point([<point referenced from the Rhino model> x4])

# ---- group: all edge elements
curve = Curve([<curve referenced from the Rhino model> x60])

# ---- group: Choose one load (applied to all points) or a list of loads (one per point)
gene_pool = GenePool(Decimals=2, Maximum=1, Minimum=0, Value=[0.5, 1, 0.5, 0.5, 0.13, 0.5, 0.5, 0.5, 0.5, 0.5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])
unit_z = UnitZ(Factor="+1")
unit_z_2 = UnitZ(Factor=gene_pool)
loads = Data(unit_z)
vector = Vector(loads)

# ---- group: Choose one q (applied to all points) or a list of qs
q = Slider(0.73, range=0.001..1)
gene_pool_2 = GenePool(Decimals=2, Maximum=1, Minimum=0, Value=[0.5, 0.29, 0.77, 0.1, 0.5, 0.04, 0.8, 0.2, 0.57, 0.15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])
force_densities = Data(q)
number = Number(force_densities)

# ---- group: get unduplicated nodes
# Force Density Method
# 
# 4.450 Fall 2019,  Yijiang Huang & Pierre Cuvilliers
# Finds the equilibrium shape of a network of bars using the force density method.
# 
# Arguments:
#       export (bool) : if True save the initial data (required to run FDM) to a json file
#       save_data_folder (string): folder to save the json file
#       compute_fdm (bool): if True, trigger the compute_fdm function directly
#       nodes (list of points):  All nodes (fixed and free) that the FDM acts on.
#       edges (list of curves): Lines connecting nodes together, and defining the
#             connectivity of the network. All end points of edges should be in nodes.
#             The connectivity is defined between endpoints of the line, points simply
#             along the line are not connected.
#       fixed_nodes (list of points): a list of fixed points, should be a subset of nodes
#       force_densities (scalar or list of scalar): The force densities. Can be one scalar
#             value that will be assigned to all edges, or a list of values, one for each edge.
#       loads (vector or list of vectors): The loads applied to the nodes of the network.
#             Can be one vector applied to all nodes, or a list of vectors, one for each node.
# 
# Returns:
#       optimized_nodes: The nodes in their equilibrium positions
#       optimized_lines: The edges in their equilibrium positions
curve_curve = CurveCurve(CurveA=curve, CurveB=curve)  # -> Points, ParamsA, ParamsB
create_set = CreateSet(List=flatten(curve_curve.Points))  # -> Set, Map

# ----
trigger_computation = BooleanToggle(True)

# ----
# fixed indices
closest_point = ClosestPoint(Point=point, Cloud=create_set.Set)  # -> ClosestPoint, CPIndex, Distance

# ----
# edge indices
edge_curves = Geometry(curve)
nodes = Geometry(create_set.Set)
end_points = EndPoints(Curve=edge_curves)  # -> Start, End
closest_point_2 = ClosestPoint(Point=end_points.Start, Cloud=nodes)  # -> ClosestPoint, CPIndex, Distance
closest_point_3 = ClosestPoint(Point=end_points.End, Cloud=nodes)  # -> ClosestPoint, CPIndex, Distance
merge = Merge(Data1=graft(closest_point_2.CPIndex), Data2=graft(closest_point_3.CPIndex))  # -> simplify(Result)

hops = Hops(
    Bool=trigger_computation,
    Nodes=create_set.Set,
    Edges=merge,
    Loads=vector,
    ForceDensities=number,
    FixedNodeID=closest_point.CPIndex,
    CacheResultsInMemory=False,
    CacheSolveResults=False,
    RemoteDefinitionLocation="http://127.0.0.1:5000/fdm",
    RemoteSolveVersion=(0, 1, 0),
    ShowInput_Enabled=False,
    ShowInput_Path=False,
    SynchronousSolve=True)

# ---- group: visualize load vectors
colour_cmyk = ColourCMYK(Cyan=1, Magenta=0, Yellow=0, Key=0)
point_2 = Point(hops)
vector_display_ex = VectorDisplayEx(Point=point_2, Vector=vector, Colour=colour_cmyk, Width=2)

# ---- group: visualize load vectors on the initial grid
vector_display_ex_2 = VectorDisplayEx(Point=flatten(curve_curve.Points), Vector=vector, Colour=colour_cmyk, Width=2)

# ----
# new edges
edge_indices = Data(merge)
list_item = ListItem(List=hops, Index=edge_indices, Wrap=True)
list_item_2 = ListItem(List=list_item, Index=0, Wrap=True)  # -> flatten(Item), flatten(Item1)
line = Line(StartPoint=list_item_2.Item, EndPoint=list_item_2.Item1)

# ---- group: visualize force density
cluster = Cluster(curve=line, number=number)  # -> point, result
text_tag_3d = TextTag3D(Location=cluster.point, Text=cluster.result, Size=Slider(0.1, range=0..1), Justification=7)

# ==== cluster Cluster
curve = ClusterInput()
number = ClusterInput()
curve_2 = Curve(reparameterize(curve))
number_2 = Number(number)
concatenate = Concatenate(FragmentA="q:", FragmentB=number_2)
evaluate_curve = EvaluateCurve(Curve=curve_2, Parameter="0.5")  # -> Point, Tangent, Angle
result = ClusterOutput(concatenate)
point = ClusterOutput(evaluate_curve.Point)
